# Grasshopper definition Kresling.gh (Grasshopper 1.0.7)

folding_factor = Slider(0.6, range=0..1)
number_of_rings = Slider(2, range=0..20)
ring_height = Slider(60, range=0..100)
number_slider = Slider(45, range=0..200)

# ---- group: UNFOLDED GEOMETRY
xy = XYPlane(Origin=Point(0, 0, 0))
faces_in_1_ring = Slider(6, range=0..10)
cir = Circle(Plane=xy, Radius=number_slider)
divide = DivideCurve(Curve=cir, Count=faces_in_1_ring, Kinks=False)  # -> Points, Tangents, Parameters
pline = PolyLine(Vertices=divide.Points, Closed=invert(False))
Z = UnitZ(Factor=ring_height)
explode = Explode(Curve=pline, Recursive=True)  # -> Segments, Vertices
move = Move(Geometry=pline, Motion=Z)  # -> Geometry, Transform
rotate = Rotate(Geometry=move.Geometry, Angle=1.570796327, Plane=PlaneXY(0, 0, 0))  # -> Geometry, Transform
explode_2 = Explode(Curve=rotate.Geometry, Recursive=True)  # -> Segments, Vertices
cull_i = CullIndex(List=explode.Vertices, Indices="0", Wrap=True)
cull_i_2 = CullIndex(List=explode_2.Vertices, Indices="-1", Wrap=True)
extr = ExtrudePoint(Base=explode_2.Segments, Point=cull_i)
extr_2 = ExtrudePoint(Base=explode.Segments, Point=cull_i_2)
join = BrepJoin(Breps=flatten([extr_2, extr]))  # -> Breps, Closed
rotate_2 = Rotate(Geometry=join.Breps, Angle=1.570796327, Plane=PlaneXY(0, 0, 0))  # -> Geometry, Transform
move_2 = Move(Geometry=rotate_2.Geometry, Motion=Z)  # -> Geometry, Transform
multiplication = Multiplication(A=Z, B="2")
group = Group(Objects=[join.Breps, move_2.Geometry])
arrlinear = LinearArray(Geometry=group, Direction=multiplication, Count=number_of_rings)  # -> Geometry, Transform
ungroup = Ungroup(Group=arrlinear.Geometry)
join_2 = BrepJoin(Breps=flatten(ungroup))  # -> Breps, Closed
cap = CapHoles(Brep=join_2.Breps)
volume = Volume(Geometry=cap)  # -> Volume, Centroid

# ---- group: VOLUME ESTIMATION OF UNFOLDED GEOMETRY
pdecon = Deconstruct(Point=volume.Centroid)  # -> XComponent, YComponent, ZComponent
multiplication_2 = Multiplication(A=pdecon.ZComponent, B="2")
division = Division(A="45", B=number_slider)
division_2 = Division(A=number_slider, B="45")
crv = Curve(<curve referenced from the Rhino model>)
scale = Scale(Geometry=crv, Center=Point(0, 0, 0), Factor=division_2)  # -> Geometry, Transform
pt = ConstructPoint(XCoordinate="0", YCoordinate="0", ZCoordinate=multiplication_2)
extr_3 = Extrude(Base=scale.Geometry, Direction=pt)
join_3 = BrepJoin(Breps=extr_3)  # -> Breps, Closed
cap_2 = CapHoles(Brep=join_3.Breps)
volume_2 = Volume(Geometry=cap_2)  # -> Volume, Centroid

# ---- group: FOLDING GEOMETRY
sunion = SolidUnion(Breps=join.Breps)
smesh = SimpleMesh(Brep=sunion)
debrep = DeconstructBrep(Brep=sunion)  # -> Faces, Edges, Vertices
weld = WeldMesh(Mesh=smesh, Angle=3.141592654)
item = ListItem(List=debrep.Vertices, Index="9", Wrap=True)
demesh = DeconstructMesh(Mesh=weld)  # -> Vertices, Faces, Colours, Normals
vec = VectorXYZ(XComponent="45", YComponent="0", ZComponent="50")  # -> Vector, Length
Z_2 = UnitZ(Factor="50")
choose_vertices = Panel("""0
2
4
6
8
10""")
item_2 = ListItem(List=demesh.Vertices, Index=choose_vertices, Wrap=True)
xy_2 = XYPlane(Origin=Z_2)
angle = Angle(VectorA=item, VectorB=vec.Vector, Plane=xy_2)  # -> Angle, Reflex
rotate_3 = Rotate(Geometry=item_2, Angle=angle.Angle, Plane=PlaneXY(0, 0, 0))  # -> Geometry, Transform
multiplication_3 = Multiplication(A=ring_height, B="-1")
multiplication_4 = Multiplication(A=multiplication_3, B=folding_factor)
multiplication_5 = Multiplication(A=multiplication_4, B=division)
Z_3 = UnitZ(Factor=multiplication_5)
move_3 = Move(Geometry=rotate_3.Geometry, Motion=Z_3)  # -> Geometry, Transform
vec2pt = Vector2Pt(PointA=item_2, PointB=move_3.Geometry, Unitize=False)  # -> Vector, Length
pdeform = PointDeform(Geometry=weld, Points=item_2, Motion=vec2pt.Vector)
demesh_2 = DeconstructMesh(Mesh=pdeform)  # -> Vertices, Faces, Colours, Normals
item_3 = ListItem(List=demesh_2.Vertices, Index="1", Wrap=True)
item_4 = ListItem(List=demesh_2.Vertices, Index="0", Wrap=True)
vec2pt_2 = Vector2Pt(PointA=item_4, PointB=item_3, Unitize=False)  # -> Vector, Length
devec = DeconstructVector(Vector=vec2pt_2.Vector)  # -> XComponent, YComponent, ZComponent
division_3 = Division(A=number_of_rings, B="2")
multiplication_6 = Multiplication(A=devec.ZComponent, B="-1")
group_2 = Group(Objects=pdeform)
multiplication_7 = Multiplication(A=division_3, B="4")
pt_2 = ConstructPoint(XCoordinate="0", YCoordinate="0", ZCoordinate=multiplication_6)
arrlinear_2 = LinearArray(Geometry=group_2, Direction=pt_2, Count=multiplication_7)  # -> Geometry, Transform
ungroup_2 = Ungroup(Group=arrlinear_2.Geometry)
faceb = FaceBoundaries(Mesh=ungroup_2)
join_4 = BrepJoin(Breps=flatten(faceb))  # -> Breps, Closed
cap_3 = CapHoles(Brep=join_4.Breps)
volume_3 = Volume(Geometry=cap_3)  # -> Volume, Centroid

# ---- group: INTERIOR FOLDING VOLUME
item_5 = ListItem(List=demesh_2.Vertices, Index="0", Wrap=True)
pdecon_2 = Deconstruct(Point=item_5)  # -> XComponent, YComponent, ZComponent
crv_2 = Curve(<curve referenced from the Rhino model>)
scale_2 = Scale(Geometry=crv_2, Center=Point(0, 0, 0), Factor=division_2)  # -> Geometry, Transform
pt_3 = ConstructPoint(XCoordinate="0", YCoordinate="0", ZCoordinate=pdecon_2.ZComponent)
extr_4 = Extrude(Base=scale_2.Geometry, Direction=pt_3)
cap_4 = CapHoles(Brep=extr_4)
volume_4 = Volume(Geometry=cap_4)  # -> Volume, Centroid
pdecon_3 = Deconstruct(Point=volume_4.Centroid)  # -> XComponent, YComponent, ZComponent
multiplication_8 = Multiplication(A=volume_4.Volume, B=number_of_rings)
multiplication_9 = Multiplication(A=pdecon_3.ZComponent, B="2")
multiplication_10 = Multiplication(A=multiplication_9, B=number_of_rings)

# ---- group: OUTPUTS
total_volume = Panel(volume.Volume)
total_volume_usable = Panel(volume_2.Volume)
folding_volume = Panel(volume_3.Volume)
folding_volume_usable = Panel(multiplication_8)
flded_z = Panel(multiplication_10)
