# Grasshopper definition MiuraOri.gh (Grasshopper 1.0.7)
# plug-ins: Pufferfish

# ---- group: INPUTS
folding_factor = Slider(0.6, range=0..1)
rings = Slider(5, range=0..10)
radius = Slider(45, range=0..200)

# ----
bcs_the_reference_geometry_was_with_45mm = Panel("45")  # "bcs the reference geometry was with 45mm radius"
centroid = Point(<point referenced from the Rhino model>)
division = Division(A=radius, B=bcs_the_reference_geometry_was_with_45mm)
panel = Panel("""5
9
16
23
26""")

srf = Surface([<surface referenced from the Rhino model> x20])
scale = Scale(Geometry=srf, Center=centroid, Factor=division)  # -> Geometry, Transform

# ---- group: FOLDING
join = BrepJoin(Breps=flatten(scale.Geometry))  # -> Breps, Closed
smesh = SimpleMesh(Brep=join.Breps)
weld = WeldMesh(Mesh=smesh, Angle=3.141592654)
demesh = DeconstructMesh(Mesh=weld)  # -> Vertices, Faces, Colours, Normals
crv = Curve(<curve referenced from the Rhino model>)
panel_2 = Panel("""0
2
7
8
17
18
19
21
28
29""")
panel_3 = Panel("""1
3
6
10
11
14
15
20
25
27""")
panel_4 = Panel("""1
4
13
10
7""")
panel_5 = Panel("""0
3
6
9
12""")
panel_6 = Panel("""4
5
9
12
13
16
22
23
24
26""")
list_item = ListItem(List=demesh.Vertices, Index=panel_2, Wrap=True)
z_0_5 = ListItem(List=demesh.Vertices, Index=panel_3, Wrap=True)
list_item_2 = ListItem(List=demesh.Vertices, Index=panel_6, Wrap=True)
panel_7 = Panel("""1
4
6
7
8""")
panel_8 = Panel("""1
2
5
4
9""")
panel_9 = Panel("""1
2
5
7
9""")
panel_10 = Panel("""3
9
5
2
0""")
panel_11 = Panel("""0
3
4
6
8""")
panel_12 = Panel("""0
3
4
1
2""")
item = ListItem(List=list_item, Index=panel_8, Wrap=True)
item_2 = ListItem(List=z_0_5, Index=panel_7, Wrap=True)
item_3 = ListItem(List=z_0_5, Index=panel_10, Wrap=True)
item_4 = ListItem(List=list_item_2, Index=panel_11, Wrap=True)
item_5 = ListItem(List=list_item_2, Index=panel_9, Wrap=True)
sort_pt = SortPoints(Points=item_3)  # -> Points, Indices
item_6 = ListItem(List=item_4, Index="0", Wrap=True)
pdecon = Deconstruct(Point=item_6)  # -> XComponent, YComponent, ZComponent
item_7 = ListItem(List=item_2, Index="0", Wrap=True)
Z = UnitZ(Factor=pdecon.ZComponent)
pdecon_2 = Deconstruct(Point=item_7)  # -> XComponent, YComponent, ZComponent
multiplication = Multiplication(A=Z, B="-1")
Z_2 = UnitZ(Factor=pdecon_2.ZComponent)
move = Move(Geometry=item_4, Motion=multiplication)  # -> Geometry, Transform
multiplication_2 = Multiplication(A=Z_2, B="-1")
vec2pt = Vector2Pt(PointA=item_4, PointB=move.Geometry, Unitize=False)  # -> Vector, Length
multiplication_3 = Multiplication(A=vec2pt.Vector, B=folding_factor)
move_2 = Move(Geometry=item_2, Motion=multiplication_2)  # -> Geometry, Transform
vec2pt_2 = Vector2Pt(PointA=item_2, PointB=move_2.Geometry, Unitize=False)  # -> Vector, Length
multiplication_4 = Multiplication(A=vec2pt_2.Vector, B=folding_factor)
crv_2 = Curve(<curve referenced from the Rhino model>)
panel_13 = Panel("""8
2
4
6
0""")

# ----
item_8 = ListItem(List=demesh.Vertices, Index="4", Wrap=True)
devec = DeconstructVector(Vector=item_8)  # -> XComponent, YComponent, ZComponent
pt = ConstructPoint(XCoordinate="0", YCoordinate="0", ZCoordinate=devec.ZComponent)
arrlinear = LinearArray(Geometry=scale.Geometry, Direction=pt, Count=rings)  # -> Geometry, Transform
ungroup = Ungroup(Group=arrlinear.Geometry)
smesh_2 = SimpleMesh(Brep=ungroup)
faceb = FaceBoundaries(Mesh=smesh_2)
join_2 = BrepJoin(Breps=flatten(faceb))  # -> Breps, Closed
cap = CapHoles(Brep=join_2.Breps)
volume = Volume(Geometry=cap)  # -> Volume, Centroid

scale_2 = Scale(Geometry=crv, Center=centroid, Factor=division)  # -> Geometry, Transform

# ---- group: Available volume of the unfolded geometry
pdecon_3 = Deconstruct(Point=volume.Centroid)  # -> XComponent, YComponent, ZComponent
multiplication_5 = Multiplication(A=pdecon_3.ZComponent, B="-2")
multiplication_6 = Multiplication(A=pdecon_3.ZComponent, B="2")
crv_3 = Curve(<curve referenced from the Rhino model>)
pt_2 = Point(<point referenced from the Rhino model>)
scale_3 = Scale(Geometry=crv_3, Center=pt_2, Factor=division)  # -> Geometry, Transform
pt_3 = ConstructPoint(XCoordinate="0", YCoordinate="0", ZCoordinate=multiplication_5)
extr = Extrude(Base=scale_3.Geometry, Direction=pt_3)
cap_2 = CapHoles(Brep=extr)
volume_2 = Volume(Geometry=cap_2)  # -> Volume, Centroid

# ----
join_3 = JoinCurves(Curves=crv_2, Preserve=False)
division_2 = Division(A=volume_2.Volume, B=volume.Volume)

# ---- group: FOLDING (continued)
cp = ControlPoints(Curve=scale_2.Geometry)  # -> Points, Weights, Knots
item_9 = ListItem(List=cp.Points, Index=panel_4, Wrap=True)
item_10 = ListItem(List=cp.Points, Index=panel_5, Wrap=True)
sort_pt_2 = SortPoints(Points=item_9)  # -> Points, Indices
sort_pt_3 = SortPoints(Points=item_10)  # -> Points, Indices
item_11 = ListItem(List=sort_pt_2.Points, Index=panel_12, Wrap=True)
vec2pt_3 = Vector2Pt(PointA=item_5, PointB=item_11, Unitize=False)  # -> Vector, Length
multiplication_7 = Multiplication(A=vec2pt_3.Vector, B=folding_factor)
vec2pt_4 = Vector2Pt(PointA=sort_pt.Points, PointB=sort_pt_3.Points, Unitize=False)  # -> Vector, Length
vec2pt_5 = Vector2Pt(PointA=item, PointB=item_9, Unitize=False)  # -> Vector, Length
multiplication_8 = Multiplication(A=vec2pt_4.Vector, B=folding_factor)
pdeform = PointDeform(Geometry=weld, Points=[item, item_5, item_3], Motion=[vec2pt_5.Vector, multiplication_7, multiplication_8])
pdeform_2 = PointDeform(Geometry=pdeform, Points=[item_4, item_2], Motion=[multiplication_3, multiplication_4])
demesh_2 = DeconstructMesh(Mesh=join_3)  # -> Vertices, Faces, Colours, Normals
demesh_3 = DeconstructMesh(Mesh=pdeform_2)  # -> Vertices, Faces, Colours, Normals
item_12 = ListItem(List=demesh_3.Vertices, Index="4", Wrap=True)
item_13 = ListItem(List=demesh_2.Vertices, Index=panel_13, Wrap=True)
devec_2 = DeconstructVector(Vector=item_12)  # -> XComponent, YComponent, ZComponent
scale_4 = Scale(Geometry=item_13, Center=centroid, Factor=division)  # -> Geometry, Transform
vec = VectorXYZ(XComponent="0", YComponent="0", ZComponent=devec_2.ZComponent)  # -> Vector, Length

# ---- group: Available volume of the folded geometry and the maximum height
crv_4 = Curve(<curve referenced from the Rhino model>)
scale_5 = Scale(Geometry=crv_4, Center=centroid, Factor=division)  # -> Geometry, Transform
multiplication_9 = Multiplication(A=vec.Vector, B=rings)
extr_2 = Extrude(Base=scale_5.Geometry, Direction=multiplication_9)
cap_3 = CapHoles(Brep=extr_2)
smesh_3 = SimpleMesh(Brep=cap_3)
volume_3 = Volume(Geometry=cap_3)  # -> Volume, Centroid
weld_2 = WeldMesh(Mesh=smesh_3, Angle=3.141592654)
demesh_4 = DeconstructMesh(Mesh=weld_2)  # -> Vertices, Faces, Colours, Normals
item_14 = ListItem(List=demesh_4.Vertices, Index="2", Wrap=True)
pdecon_4 = Deconstruct(Point=item_14)  # -> XComponent, YComponent, ZComponent

# ----
item_15 = ListItem(List=demesh_3.Vertices, Index=panel, Wrap=True)

# ---- group: FOLDING (continued)
vec2pt_6 = Vector2Pt(PointA=item_15, PointB=scale_4.Geometry, Unitize=False)  # -> Vector, Length

# ----
pdeform_3 = PointDeform(Geometry=pdeform_2, Points=item_15, Motion=vec2pt_6.Vector)

# ---- group: FOLDING (continued)
arrlinear_2 = LinearArray(Geometry=pdeform_3, Direction=vec.Vector, Count=rings)  # -> Geometry, Transform

# ----
clsmsh = CloseMesh(Mesh=arrlinear_2.Geometry, Quadrangulate=True)  # -> Closed, Amount, Openings, R

# ---- group: FOLDING (continued)
volume_4 = Volume(Geometry=clsmsh.Closed)  # -> Volume, Centroid
item_16 = ListItem(List=volume_4.Volume, Index="0", Wrap=True)
multiplication_10 = Multiplication(A=item_16, B=rings)

# ----
division_3 = Division(A=volume_3.Volume, B=multiplication_10)

total_folding_volume = Panel(multiplication_10)
total_volume_usable = Panel(volume_2.Volume)
volume_ratio = Panel(division_2)
total_z = Panel(multiplication_6)
usable_folding_volume = Panel(volume_3.Volume)
total_volume = Panel(volume.Volume)
folded_z = Panel(pdecon_4.ZComponent)

folding_volume_ratio = Panel(division_3)
