# Grasshopper definition Yoshimura.gh (Grasshopper 1.0.7)
# plug-ins: Kangaroo2 Components

# ---- group: GEOMETRY INPUTS
folding_factor = Slider(0.6, range=0..1)
ring_height = Slider(80, range=0..200)
radius = Slider(120, range=0..200)
rings = Slider(3, range=0..10)

# ---- group: YOSHIMURA GEOMETRY
xy = XYPlane(Origin=Point(0, 0, 0))
faces_in_1_ring = Slider(6, range=0..10)
cir = Circle(Plane=xy, Radius=radius)
divide = DivideCurve(Curve=cir, Count=faces_in_1_ring, Kinks=False)  # -> Points, Tangents, Parameters
pline = PolyLine(Vertices=divide.Points, Closed=invert(False))
Z = UnitZ(Factor=ring_height)
expression = Expression(x=faces_in_1_ring, Expression="2*pi/(x*2)")
explode = Explode(Curve=pline, Recursive=True)  # -> Segments, Vertices
move = Move(Geometry=pline, Motion=Z)  # -> Geometry, Transform
rotate = Rotate(Geometry=move.Geometry, Angle=expression, Plane=PlaneXY(0, 0, 0))  # -> Geometry, Transform
explode_2 = Explode(Curve=rotate.Geometry, Recursive=True)  # -> Segments, Vertices
cull_i = CullIndex(List=explode.Vertices, Indices="0", Wrap=True)
cull_i_2 = CullIndex(List=explode_2.Vertices, Indices="-1", Wrap=True)
extr = ExtrudePoint(Base=explode_2.Segments, Point=cull_i)
extr_2 = ExtrudePoint(Base=explode.Segments, Point=cull_i_2)
join = BrepJoin(Breps=flatten([extr, extr_2]))  # -> Breps, Closed
rotate_2 = Rotate(Geometry=join.Breps, Angle=expression, Plane=PlaneXY(0, 0, 0))  # -> Geometry, Transform
move_2 = Move(Geometry=rotate_2.Geometry, Motion=Z)  # -> Geometry, Transform
group = Group(Objects=[join.Breps, move_2.Geometry])
multiplication = Multiplication(A=Z, B="2")
arrlinear = LinearArray(Geometry=group, Direction=multiplication, Count=rings)  # -> Geometry, Transform
ungroup = Ungroup(Group=arrlinear.Geometry)
join_2 = BrepJoin(Breps=flatten(ungroup))  # -> Breps, Closed
cap = CapHoles(Brep=join_2.Breps)
volume = Volume(Geometry=cap)  # -> Volume, Centroid
pdecon = Deconstruct(Point=volume.Centroid)  # -> XComponent, YComponent, ZComponent

# ----
division = Division(A=radius, B="45")

# ---- group: AVAILABLE VOLUME
multiplication_2 = Multiplication(A=radius, B="40/45")
cir_2 = Circle(Plane=xy, Radius=multiplication_2)
multiplication_3 = Multiplication(A=faces_in_1_ring, B="2")
multiplication_4 = Multiplication(A=pdecon.ZComponent, B="2")
divide_2 = DivideCurve(Curve=cir_2, Count=multiplication_3, Kinks=False)  # -> Points, Tangents, Parameters
pt = ConstructPoint(XCoordinate="0", YCoordinate="0", ZCoordinate=multiplication_4)
pline_2 = PolyLine(Vertices=divide_2.Points, Closed=invert(False))
extr_3 = Extrude(Base=pline_2, Direction=pt)
rotate_3 = Rotate(Geometry=extr_3, Angle="pi/12", Plane=PlaneXY(0, 0, 0))  # -> Geometry, Transform
cap_2 = CapHoles(Brep=rotate_3.Geometry)
volume_2 = Volume(Geometry=cap_2)  # -> Volume, Centroid

# ---- group: FOLDING
ungroup_2 = Ungroup(Group=group)
crv = Curve([<curve referenced from the Rhino model> x72])
join_3 = BrepJoin(Breps=ungroup_2)  # -> Breps, Closed
join_4 = JoinCurves(Curves=crv, Preserve=False)
sunion = SolidUnion(Breps=join_3.Breps)
smesh = SimpleMesh(Brep=sunion)
weld = WeldMesh(Mesh=smesh, Angle=3.141592654)
demesh = DeconstructMesh(Mesh=weld)  # -> Vertices, Faces, Colours, Normals
panel = Panel("""10
3
4
11
9
8""")
panel_2 = Panel("""17
12
13
16
14
15""")
panel_3 = Panel("""4
6
7
8
9
10""")
panel_4 = Panel("""0
1
2
3
5
17""")
panel_5 = Panel("""11
12
13
14
15
16""")
list_item = ListItem(List=demesh.Vertices, Index=panel_3, Wrap=True)
z_0_5 = ListItem(List=demesh.Vertices, Index=panel_4, Wrap=True)
list_item_2 = ListItem(List=demesh.Vertices, Index=panel_5, Wrap=True)
item = ListItem(List=demesh.Vertices, Index="17", Wrap=True)

# ----
scale = Scale(Geometry=join_4, Center=Point(0, 0, 0), Factor=division)  # -> Geometry, Transform

# ---- group: FOLDING (continued)
cp = ControlPoints(Curve=scale.Geometry)  # -> flatten(Points), Weights, Knots
duppt = RemoveDuplicatePts(Points=cp.Points, Tolerance=0.01)  # -> flatten(UniquePoints)
item_2 = ListItem(List=duppt, Index=panel_2, Wrap=True)
item_3 = ListItem(List=duppt, Index=panel, Wrap=True)
vec2pt = Vector2Pt(PointA=list_item, PointB=item_2, Unitize=False)  # -> Vector, Length
vec2pt_2 = Vector2Pt(PointA=z_0_5, PointB=item_3, Unitize=False)  # -> Vector, Length
vec2pt_3 = Vector2Pt(PointA=list_item_2, PointB=item_2, Unitize=False)  # -> Vector, Length
multiplication_5 = Multiplication(A=vec2pt_3.Vector, B=folding_factor)
multiplication_6 = Multiplication(A=vec2pt_2.Vector, B=folding_factor)
multiplication_7 = Multiplication(A=vec2pt.Vector, B=folding_factor)
pdeform = PointDeform(Geometry=weld, Points=list_item, Motion=multiplication_7)
pdeform_2 = PointDeform(Geometry=pdeform, Points=z_0_5, Motion=multiplication_6)
pdeform_3 = PointDeform(Geometry=pdeform_2, Points=list_item_2, Motion=multiplication_5)
demesh_2 = DeconstructMesh(Mesh=pdeform_3)  # -> Vertices, Faces, Colours, Normals
item_4 = ListItem(List=demesh_2.Vertices, Index="13", Wrap=True)
item_5 = ListItem(List=demesh_2.Vertices, Index="8", Wrap=True)
devec = DeconstructVector(Vector=item_4)  # -> XComponent, YComponent, ZComponent
devec_2 = DeconstructVector(Vector=item_5)  # -> XComponent, YComponent, ZComponent
subtraction = Subtraction(A=devec.ZComponent, B=devec_2.ZComponent)
pt_2 = ConstructPoint(XCoordinate="0", YCoordinate="0", ZCoordinate=subtraction)
arrlinear_2 = LinearArray(Geometry=pdeform_3, Direction=pt_2, Count=rings)  # -> Geometry, Transform
ungroup_3 = Ungroup(Group=arrlinear_2.Geometry)
faceb = FaceBoundaries(Mesh=ungroup_3)
join_5 = BrepJoin(Breps=flatten(faceb))  # -> Breps, Closed
cap_3 = CapHoles(Brep=join_5.Breps)
volume_3 = Volume(Geometry=cap_3)  # -> Volume, Centroid

# ---- group: FOLDING AVAILABLE VOLUME
devec_3 = DeconstructVector(Vector=volume_3.Centroid)  # -> XComponent, YComponent, ZComponent
multiplication_8 = Multiplication(A=devec_3.ZComponent, B="2")
crv_2 = Curve(<curve referenced from the Rhino model>)
pt_3 = ConstructPoint(XCoordinate="0", YCoordinate="0", ZCoordinate=multiplication_8)
scale_2 = Scale(Geometry=crv_2, Center=Point(0, 0, 0), Factor=division)  # -> Geometry, Transform
extr_4 = Extrude(Base=scale_2.Geometry, Direction=pt_3)
cap_4 = CapHoles(Brep=extr_4)
volume_4 = Volume(Geometry=cap_4)  # -> Volume, Centroid
pdecon_2 = Deconstruct(Point=volume_4.Centroid)  # -> XComponent, YComponent, ZComponent
multiplication_9 = Multiplication(A=pdecon_2.ZComponent, B="2")

# ---- group: OUTPUTS
total_volume = Panel(volume.Volume)
total_folding_volume = Panel(volume_3.Volume)
usable_folding_volume = Panel(volume_4.Volume)
max_height_z = Panel(multiplication_9)
total_volume_usable = Panel(volume_2.Volume)
